# Grasshopper definition GrasshopperCustomColourmap.gh (Grasshopper 1.0.7)

divisions = Slider(100, range=1..100)
rectangle_2pt = Rectangle2Pt(Plane=PlaneXY(0, 0, 0), PointA=Point(0, 0, 0), PointB="{20,5,0}", Radius=0)  # -> Rectangle, Length
surface = Surface(rectangle_2pt.Rectangle)
divide_domain² = DivideDomain²(Domain=surface, UCount=expr("x+1", divisions), VCount=1)
range = Range(Domain=Domain(0, 1), Steps=divisions)
isotrim = Isotrim(Surface=rectangle_2pt.Rectangle, Domain=divide_domain²)
ghpython_script = GhPythonScript(ColourMap="turbo", Value=range)  # -> out, ValueColour
# ---------- ghpython_script: Python ----------
"""Custom Colour Mapping Component
    Inputs:
        ColourMap: Name of the colour map
        Colour: Value to map to colour
    Output:
        ValueColour: The a output variable"""

__author__ = "Mitchell.Tesch"
__version__ = "2022.07.29"

import rhinoscriptsyntax as rs
import Rhino as rh
import math

# Colour Map RGB Data from the following sources:
# turbo by Anton Mikhailov - https://gist.github.com/mikhailov-work/ee72ba4191942acecc03fe6da94fc73f
# viridis, plasma, inferno, magma, cividis, hot, coolwarm, spectral, seismic by Matplotlib - https://matplotlib.org/stable/tutorials/colors/colormaps.html

# Interpolation method adapted from script by Anton Mikhailov - https://gist.github.com/mikhailov-work/ee72ba4191942acecc03fe6da94fc73f

colour_maps = {'turbo':[[0.18995,0.07176,0.23217],[0.19483,0.08339,0.26149],[0.19956,0.09498,0.29024],[0.20415,0.10652,0.31844],[0.20860,0.11802,0.34607],[0.21291,0.12947,0.37314],[0.21708,0.14087,0.39964],[0.22111,0.15223,0.42558],[0.22500,0.16354,0.45096],[0.22875,0.17481,0.47578],[0.23236,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
               'viridis':[[0.267, 0.00487, 0.32942], [0.26851, 0.00961, 0.33543], [0.26994, 0.01462, 0.34138], [0.27131, 0.01994, 0.34727], [0.27259, 0.02556, 0.35309], [0.27381, 0.0315, 0.35885], [0.27495, 0.03775, 0.36454], [0.27602, 0.04417, 0.37016], [0.27702, 0.05034, 0.37572], [0.27794,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
               'plasma':[[0.05038, 0.0298, 0.52798], [0.06354, 0.02843, 0.53312], [0.07535, 0.02721, 0.53801], [0.08622, 0.02612, 0.54266], [0.09638, 0.02516, 0.5471], [0.10598, 0.02431, 0.55137], [0.11512, 0.02356, 0.55547], [0.1239, 0.02288, 0.55942], [0.13238, 0.02226, 0.56325], [0.1406, 0.02169,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
               'inferno':[[0.00146, 0.00047, 0.01387], [0.00227, 0.00127, 0.01857], [0.0033, 0.00225, 0.02424], [0.00455, 0.00339, 0.03091], [0.00601, 0.00469, 0.03856], [0.00768, 0.00614, 0.04684], [0.00956, 0.00771, 0.05514], [0.01166, 0.00942, 0.06346], [0.014, 0.01122, 0.07186], [0.01656,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
               'magma':[[0.00146, 0.00047, 0.01387], [0.00226, 0.0013, 0.01833], [0.00328, 0.00231, 0.02371], [0.00451, 0.00349, 0.02996], [0.00595, 0.00484, 0.03713], [0.00759, 0.00636, 0.04497], [0.00943, 0.00802, 0.05284], [0.01146, 0.00983, 0.06075], [0.01371, 0.01177, 0.06867], [0.01616,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
               'cividis':[[0.0, 0.13511, 0.30475], [0.0, 0.13807, 0.31111], [0.0, 0.14101, 0.31758], [0.0, 0.14395, 0.32398], [0.0, 0.14688, 0.33048], [0.0, 0.14979, 0.33706], [0.0, 0.15267, 0.3437], [0.0, 0.15538, 0.3505], [0.0, 0.15793, 0.35752], [0.0, 0.1605, 0.36453], [0.0, 0.16306, 0.37161],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
               'cool':[[0.0, 1.0, 1.0], [0.00392, 0.99608, 1.0], [0.00784, 0.99216, 1.0], [0.01176, 0.98824, 1.0], [0.01569, 0.98431, 1.0], [0.01961, 0.98039, 1.0], [0.02353, 0.97647, 1.0], [0.02745, 0.97255, 1.0], [0.03137, 0.96863, 1.0], [0.03529, 0.96471, 1.0], [0.03922, 0.96078, 1.0], [0.04314,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
               'hot':[[0.0416, 0.0, 0.0], [0.05189, 0.0, 0.0], [0.06219, 0.0, 0.0], [0.07248, 0.0, 0.0], [0.08278, 0.0, 0.0], [0.09307, 0.0, 0.0], [0.10337, 0.0, 0.0], [0.11366, 0.0, 0.0], [0.12396, 0.0, 0.0], [0.13425, 0.0, 0.0], [0.14455, 0.0, 0.0], [0.15484, 0.0, 0.0], [0.16514, 0.0, 0.0],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
               'coolwarm':[[0.22981, 0.29872, 0.75368], [0.23438, 0.30554, 0.75968], [0.23895, 0.31237, 0.76568], [0.24352, 0.31919, 0.77167], [0.24809, 0.32601, 0.77767], [0.25266, 0.33284, 0.78367], [0.25723, 0.33966, 0.78966], [0.26181, 0.34648, 0.79566], [0.26638, 0.3533, 0.80164], [0.2711,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
               'spectral':[[0.61961, 0.00392, 0.25882], [0.62807, 0.0133, 0.26082], [0.63652, 0.02268, 0.26282], [0.64498, 0.03206, 0.26482], [0.65344, 0.04145, 0.26682], [0.6619, 0.05083, 0.26882], [0.67036, 0.06021, 0.27082], [0.67882, 0.06959, 0.27282], [0.68727, 0.07897, 0.27482], [0.69573,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
               'seismic':[[0.0, 0.0, 0.3], [0.0, 0.0, 0.31098], [0.0, 0.0, 0.32196], [0.0, 0.0, 0.33294], [0.0, 0.0, 0.34392], [0.0, 0.0, 0.3549], [0.0, 0.0, 0.36588], [0.0, 0.0, 0.37686], [0.0, 0.0, 0.38784], [0.0, 0.0, 0.39882], [0.0, 0.0, 0.4098], [0.0, 0.0, 0.42078], [0.0, 0.0, 0.43176], [0.0,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
               }

def interpolate(colour_map, v):
  v = max(0.0, min(1.0, v))
  a = int(v*255.0)
  b = min(255, a + 1)
  f = v*255.0 - a
  return rs.CreateColor(math.floor((colour_map[a][0] + (colour_map[b][0] - colour_map[a][0]) * f) * 255),
                        math.floor((colour_map[a][1] + (colour_map[b][1] - colour_map[a][1]) * f) * 255),
                        math.floor((colour_map[a][2] + (colour_map[b][2] - colour_map[a][2]) * f) * 255))

def interpolate_or_clip(colour_map, v):
  if   v < 0.0: 
      return [0.0, 0.0, 0.0]
  elif v > 1.0:
      return [1.0, 1.0, 1.0]
  else:
      return interpolate(colour_map, v)

if ColourMap in colour_maps.keys():
    print(ColourMap)
    ValueColour = interpolate_or_clip(colour_map=colour_maps[ColourMap],v=Value)
else:
    print('ColourMap not one of %s.' %colour_maps.keys())
# ---------- end ghpython_script ----------
custom_preview = CustomPreview(Geometry=isotrim, Material=ghpython_script.ValueColour)
panel = Panel(ghpython_script.out)
